# Grasshopper definition DiTWP_GH_Skizze-Parametrisch.gh (Grasshopper 1.0.8)

# ----
# Parameter
# Parametrisieren der Skizze - Wand
breite = Slider(1, range=0..2)
# Einlesen der in Rhino gezeichneten Elemente ins Grasshopper
wanddicke = Slider(0.3, range=0..1)
länge = Panel("6")
wandhoehe = Panel("3.15")
deckendicke = Slider(0.3, range=0..1)
deckendicke_2 = Number(deckendicke)
wandhoehe_2 = Number(wandhoehe)
wanddicke_2 = Number(wanddicke)
laenge = Number(länge)

# ----
# Parametrisieren der Skizze - Decke
curve = Curve(<curve referenced from the Rhino model>)
curve_2 = Curve(<curve referenced from the Rhino model>)
# Die Elemente werden in Einzelteile zerlegt
deconstruct_brep = DeconstructBrep(Brep=curve_2)  # -> Faces, Edges, Vertices
deconstruct_brep_2 = DeconstructBrep(Brep=curve)  # -> Faces, Edges, Vertices
breite_2 = Number(breite)
# Eckpunkte
panel = Panel(deconstruct_brep.Vertices)
# Eckpunkte
panel_2 = Panel(deconstruct_brep_2.Vertices)
list_length = ListLength(List=panel)
list_length_2 = ListLength(List=panel_2)
# Zerlegen der Punkte auf
# einzelne Koordinaten (X, Y, Z)
deconstruct = Deconstruct(Point=deconstruct_brep_2.Vertices)  # -> XComponent, YComponent, ZComponent
# Visualisierung der Punkte im Rhino Viewport
panel_3 = Panel("0")
# Visualisierung der Punkte im Rhino Viewport
panel_4 = Panel("0")
# Zerlegen der Punkte auf
# einzelne Koordinaten (X, Y, Z)
deconstruct_2 = Deconstruct(Point=deconstruct_brep.Vertices)  # -> XComponent, YComponent, ZComponent
series = Series(Start=panel_3, Step="1", Count=list_length)
series_2 = Series(Start=panel_4, Step="1", Count=list_length_2)
z_koordinaten = Panel(deconstruct.ZComponent)
y_koordinaten = Panel(deconstruct.YComponent)
x_koordinaten = Panel(deconstruct.XComponent)
text_tag = TextTag(Location=panel, Text=series, Colour=ColourSwatch(SwatchColor=RGB(44, 193, 120)))
text_tag_2 = TextTag(Location=panel_2, Text=series_2, Colour=ColourSwatch(SwatchColor=RGB(44, 193, 120)))
z_koordinaten_2 = Panel(deconstruct_2.ZComponent)
y_koordinaten_2 = Panel(deconstruct_2.YComponent)
x_koordinaten_2 = Panel(deconstruct_2.XComponent)
wandhoehe_3 = Number(wandhoehe)
panel_5 = Panel("""1
2""")
panel_6 = Panel("""0
1""")
laenge_2 = Number(länge)
wandhoehe_4 = Number(wandhoehe)
wanddicke_3 = Number(wanddicke)
panel_7 = Panel("""2
3""")
replace_items = ReplaceItems(List=z_koordinaten, Item=wandhoehe_3, Indices=panel_6, Wrap=False)
panel_8 = Panel("""1
2""")
replace_items_2 = ReplaceItems(List=x_koordinaten, Item=laenge_2, Indices=panel_5, Wrap=False)
deckendicke_3 = Number(deckendicke)
wandhoehe_5 = Number(wandhoehe)
replace_items_3 = ReplaceItems(List=z_koordinaten_2, Item=wandhoehe_4, Indices=panel_7, Wrap=False)
replace_items_4 = ReplaceItems(List=x_koordinaten_2, Item=wanddicke_3, Indices=panel_8, Wrap=False)
addition = Addition(A=wandhoehe_5, B=deckendicke_3)
panel_9 = Panel(replace_items_2)
panel_10 = Panel("""2
3""")
panel_11 = Panel(replace_items_3)
panel_12 = Panel(replace_items_4)
replace_items_5 = ReplaceItems(List=replace_items, Item=addition, Indices=panel_10, Wrap=False)
panel_13 = Panel(replace_items_5)
construct_point = ConstructPoint(XCoordinate=panel_12, YCoordinate=y_koordinaten_2, ZCoordinate=panel_11)
construct_point_2 = ConstructPoint(XCoordinate=panel_9, YCoordinate=y_koordinaten, ZCoordinate=panel_13)
shift_list = ShiftList(List=construct_point, Shift="1", Wrap=True)
shift_list_2 = ShiftList(List=construct_point_2, Shift="1", Wrap=True)
panel_14 = Panel(shift_list)
panel_15 = Panel(shift_list_2)
line = Line(StartPoint=construct_point, EndPoint=panel_14)
line_2 = Line(StartPoint=construct_point_2, EndPoint=panel_15)
# Erstellung BREP aus den Linien
boundary_surfaces = BoundarySurfaces(Edges=line)
boundary_surfaces_2 = BoundarySurfaces(Edges=line_2)

# ----
# Extrudieren der Flächen
breite_3 = Number(breite)
unit_y = UnitY(Factor=breite_3)
extrude = Extrude(Base=boundary_surfaces_2, Direction=unit_y)
extrude_2 = Extrude(Base=boundary_surfaces, Direction=unit_y)
