# Grasshopper definition DiTWP_GH_Datenstruktur_v00.gh (Grasshopper 1.0.7)

# ----
# Liste von Elementen
panel = Panel("""1
2
3
4
5
6
7
8
9""")
data = Data(panel)
param_viewer = ParamViewer(data)
param_viewer_2 = ParamViewer(data)

panel_2 = Panel("""0
0
0""")
panel_3 = Panel("""1
1
1""")
# Data Tree (Datenbaum)
# Mehrere Listen zu einem Datenbaum zusammenführen
panel_4 = Panel("""1
2
3""")

# ----
# Datenstruktur
# Einzelnes Element
panel_5 = Panel("1")
data_2 = Data(panel_5)
param_viewer_3 = ParamViewer(data_2)
param_viewer_4 = ParamViewer(data_2)

number = Number(Tree({0;0}: [0, 1, 2], {0;1}: [3, 4, 5], {1;0}: [10, 11, 12], {1;1}: [13, 14, 15]))
größe_paneel_x = Slider(1, range=1..2)
# Ausgangspunkt
panel_6 = Panel("10,0,0")
größe_paneel_z = Slider(1, range=1..2)
anzahl_paneele_x = Slider(4, range=1..10)
anzahl_paneele_z = Slider(5, range=1..10)
xz_plane = XZPlane(Origin=panel_6)
# Händische Eingabe eines Datenbaums
# (Rechte Maustaste auf die Number Komponente / Set multiple numbers)
panel_7 = Panel(number)
construct_point = ConstructPoint(XCoordinate=panel_4, YCoordinate=panel_2, ZCoordinate=panel_3)
construct_point_2 = ConstructPoint(XCoordinate=panel_2, YCoordinate=panel_3, ZCoordinate=panel_4)
data_3 = Data(panel_7)
# Erstellung eines Rasters
rectangular = Rectangular(Plane=xz_plane, SizeX=größe_paneel_x, SizeY=größe_paneel_z, ExtentX=anzahl_paneele_x, ExtentY=anzahl_paneele_z)  # -> Cells, simplify(Points)
entwine = Entwine(Branch00=construct_point, Branch01=construct_point_2, FlattenInputs=True)  # -> simplify(Result)
param_viewer_5 = ParamViewer(data_3)
param_viewer_6 = ParamViewer(data_3)
# Äste nach X sortiert
point = Point(rectangular.Points)
panel_8 = Panel(entwine)
panel_9 = Panel(point)

# ----
# Text - Strings
# String, keine Nummer!
# Auch Strings sind Daten
# Operation mit Strings
# Nummern und String können kombiniert werden
panel_10 = Panel("""Fundament
Stütze""")
leerzeichen = Panel(" ")
number_2 = Number(panel_10)
data_4 = Data(panel_10)
number_3 = Number("1")
concatenate = Concatenate(Fragment_A=panel_10, Fragment_B=leerzeichen, Fragment_C="Achse", Fragment_D=leerzeichen, A="1")
panel_11 = Panel(concatenate)

param_viewer_7 = ParamViewer(panel_8)
param_viewer_8 = ParamViewer(panel_8)
# Umdrehen - Äste nach Z sortiert
flip_matrix = FlipMatrix(Data=point)
# Auswahl Ast 0
panel_12 = Panel("0")
param_viewer_9 = ParamViewer(panel_9)
param_viewer_10 = ParamViewer(panel_9)
panel_13 = Panel(flip_matrix)
tree_branch = TreeBranch(Tree=point, Path=panel_12, MaintainPaths=True)
panel_14 = Panel(tree_branch)
tree_branch_2 = TreeBranch(Tree=panel_8, Path="0", MaintainPaths=True)
# Auswahl Ast 3 - 4 Reihe - Nummerierung bei 0
tree_branch_3 = TreeBranch(Tree=flip_matrix, Path="3", MaintainPaths=True)
panel_15 = Panel(tree_branch_2)
param_viewer_11 = ParamViewer(panel_13)
param_viewer_12 = ParamViewer(panel_13)
panel_16 = Panel(tree_branch_3)
deconstruct = Deconstruct(Point=tree_branch_3)  # -> XComponent, YComponent, ZComponent
construct_point_3 = ConstructPoint(XCoordinate=deconstruct.XComponent, YCoordinate=deconstruct.YComponent, ZCoordinate="3.5")
tree_statistics = TreeStatistics(Tree=construct_point_3)  # -> Paths, Length, Count
split_tree = SplitTree(Data=flip_matrix, Masks=flatten(tree_statistics.Paths))  # -> Positive, Negative
merge = Merge(Data1=split_tree.Negative, Data2=construct_point_3)
panel_17 = Panel(split_tree.Positive)
panel_18 = Panel(split_tree.Negative)
panel_19 = Panel(merge)
