# Grasshopper definition DiTWP_GH_Einlesen_csv_v00.gh (Grasshopper 1.0.7)

# Einlesen CSV in GH
# Einlesen der Daten
# Rechter Mausclick /
# select one existing file
# -> Datei auswählen
file_path = FilePath("C:\ARI\41_FH_Wien\DiTWP\122_UE\DiTWP_UE-1_coord_xyz.csv")
panel = Panel(file_path)
# Achtung: die Datei muss von anderen
# Programmen geschlossen sein.
read_file = ReadFile(File=file_path, PerLineParse=True)
panel_2 = Panel(read_file)
# Punkte direkt erstellen lassen - die Komponente
# erkennt Komma nicht als Decimal (. in englischen Raum).
# Entweder das csv File mit Punkt schreiben oder nachträglich in GH Werte anpassen
import_coordinates = ImportCoordinates(File=file_path, Separator=";", Comment="X", XIndex=0, YIndex=1, ZIndex=2)
panel_3 = Panel(import_coordinates)
# Bearbeiten der gelesenen Daten
# Komma mit Punkt ausgewechselt
panel_4 = Panel(",")
replace_text = ReplaceText(Text=read_file, Find=panel_4, Replace=".", RecursiveReplace=False)
panel_5 = Panel(replace_text)
# Liste aufteilen (Kopfzeile und Werte)
panel_6 = Panel("1")
split_list = SplitList(List=replace_text, Index=panel_6)  # -> ListA, ListB
panel_7 = Panel(split_list.ListA)
panel_8 = Panel(split_list.ListB)
# Aufteilen der Zeilen auf einzelne Werte
panel_9 = Panel(";")
text_split = TextSplit(Text=split_list.ListB, Separators=panel_9)  # -> simplify(Result)
panel_10 = Panel(text_split)
# Herausziehen der Werte nach index:
# 0 = X
# 1 = Y
# 2 = Z
panel_11 = Panel("0")
list_item = ListItem(List=text_split, Index=panel_11, Wrap=True)  # -> simplify(Item)
list_item_2 = ListItem(List=text_split, Index="2", Wrap=True)  # -> simplify(Item)
list_item_3 = ListItem(List=text_split, Index="1", Wrap=True)  # -> simplify(Item)
panel_12 = Panel(list_item_2)
panel_13 = Panel(list_item_3)
panel_14 = Panel(list_item)
# Erstellung von Punkten
# ("flatten" der Liste)
construct_point = ConstructPoint(XCoordinate=panel_14, YCoordinate=panel_13, ZCoordinate=panel_12)  # -> flatten(Point)
panel_15 = Panel(construct_point)
