# Grasshopper definition DiTWP_W24_UE_1_Excel-Plus.gh (Grasshopper 1.0.8)
# plug-ins: Speckle 2, CORE.Toolbox.Grasshopper, ExcelPlus

# Rhino geo ins GH
decke_kurve = Curve(<curve referenced from the Rhino model>)

# ----
# Parameter
höhe = Panel("3.15")
breite = Slider(1, range=0..1)
wanddicke = Slider(0.2, range=0..1)
deckedicke = Slider(0.4, range=0..1)
länge = Panel("6")
breite_2 = Number(breite)
deckendicke = Number(deckedicke)
wanddicke_2 = Number(wanddicke)
höhe_2 = Number(höhe)
länge_2 = Number(länge)

wand_kurve = Curve(<curve referenced from the Rhino model>)
deconstruct_brep = DeconstructBrep(Brep=decke_kurve)  # -> Faces, Edges, Vertices
deconstruct_brep_2 = DeconstructBrep(Brep=wand_kurve)  # -> Faces, Edges, Vertices
panel = Panel(deconstruct_brep.Vertices)
panel_2 = Panel([breite_2, wanddicke, deckedicke])
panel_3 = Panel(deconstruct_brep_2.Vertices)
deconstruct = Deconstruct(Point=deconstruct_brep.Vertices)  # -> XComponent, YComponent, ZComponent
deconstruct_2 = Deconstruct(Point=deconstruct_brep_2.Vertices)  # -> XComponent, YComponent, ZComponent
panel_4 = Panel(deconstruct.XComponent)
panel_5 = Panel(deconstruct.ZComponent)
panel_6 = Panel(deconstruct_2.XComponent)
panel_7 = Panel(deconstruct_2.ZComponent)
panel_8 = Panel("""0
1""")
höhe_3 = Number(höhe)
panel_9 = Panel("""0
3""")
panel_10 = Panel("""0
1""")
panel_11 = Panel("""0
3""")
replace_items = ReplaceItems(List=deconstruct.ZComponent, Item=höhe_3, Indices=panel_8, Wrap=False)
replace_items_2 = ReplaceItems(List=deconstruct.XComponent, Item="0", Indices=panel_9, Wrap=False)
deckendicke_2 = Number(deckedicke)
replace_items_3 = ReplaceItems(List=deconstruct_2.ZComponent, Item="0", Indices=panel_10, Wrap=False)
höhe_4 = Number(höhe)
replace_items_4 = ReplaceItems(List=deconstruct_2.XComponent, Item="0", Indices=panel_11, Wrap=False)
addition = Addition(A=höhe_4, B=deckendicke_2)
panel_12 = Panel(replace_items)
panel_13 = Panel(replace_items_2)
panel_14 = Panel("""2
3""")
panel_15 = Panel(replace_items_3)
panel_16 = Panel("""1
2""")
länge_3 = Number(länge)
panel_17 = Panel(replace_items_4)
höhe_5 = Number(höhe)
panel_18 = Panel("""2
3""")
wanddicke_3 = Number(wanddicke)
panel_19 = Panel("""1
2""")
replace_items_5 = ReplaceItems(List=replace_items, Item=addition, Indices=panel_14, Wrap=False)
replace_items_6 = ReplaceItems(List=replace_items_2, Item=länge_3, Indices=panel_16, Wrap=False)
replace_items_7 = ReplaceItems(List=replace_items_3, Item=höhe_5, Indices=panel_18, Wrap=False)
replace_items_8 = ReplaceItems(List=replace_items_4, Item=wanddicke_3, Indices=panel_19, Wrap=False)
panel_20 = Panel(replace_items_5)
panel_21 = Panel(replace_items_6)
panel_22 = Panel(replace_items_7)
panel_23 = Panel(replace_items_8)
construct_point = ConstructPoint(XCoordinate=replace_items_6, YCoordinate=0, ZCoordinate=replace_items_5)
construct_point_2 = ConstructPoint(XCoordinate=replace_items_8, YCoordinate=0, ZCoordinate=replace_items_7)
list_length = ListLength(List=construct_point)
list_length_2 = ListLength(List=construct_point_2)
series = Series(Start="0", Step="1", Count=list_length)
panel_24 = Panel(construct_point)
shift_list = ShiftList(List=construct_point, Shift="1", Wrap=True)
panel_25 = Panel(construct_point_2)
shift_list_2 = ShiftList(List=construct_point_2, Shift="1", Wrap=True)
series_2 = Series(Start="0", Step="1", Count=list_length_2)
panel_26 = Panel(shift_list)
text_tag = TextTag(Location=construct_point, Text=series, Colour=ColourSwatch(SwatchColor=RGB(82, 252, 212)))
line = Line(StartPoint=construct_point, EndPoint=shift_list)
panel_27 = Panel(shift_list_2)
line_2 = Line(StartPoint=construct_point_2, EndPoint=shift_list_2)
text_tag_2 = TextTag(Location=construct_point_2, Text=series_2, Colour=ColourSwatch(SwatchColor=RGB(82, 252, 212)))
boundary_surfaces = BoundarySurfaces(Edges=line_2)
boundary_surfaces_2 = BoundarySurfaces(Edges=line)
breite_3 = Number(breite)
unit_y = UnitY(Factor=breite_3)
panel_28 = Panel(unit_y)
extrude = Extrude(Base=[boundary_surfaces_2, boundary_surfaces], Direction=unit_y)
panel_29 = Panel(extrude)
# Deconstruct brep
brep = Brep(extrude)
panel_30 = Panel(brep)
deconstruct_brep_3 = DeconstructBrep(Brep=brep)  # -> Faces, Edges, Vertices
panel_31 = Panel(deconstruct_brep_3.Vertices)
fit_line = FitLine(Points=deconstruct_brep_3.Vertices)
panel_32 = Panel(fit_line)
# Explode
explode = Explode(Curve=fit_line, Recursive=True)  # -> flatten(Segments), flatten(Vertices)
punkte = Panel(explode.Vertices)
linien = Panel(explode.Segments)
list_item = ListItem(List=explode.Segments, Index="1", Wrap=True)
list_item_2 = ListItem(List=explode.Segments, Index="0", Wrap=True)
decke_linie = Line(list_item_2)
wand_linie = Line(list_item)
line_line = LineLine(Line1=decke_linie, Line2=wand_linie)  # -> ParamA, ParamB, PointA, PointB
punkte_2 = Point([explode.Vertices, line_line.PointA])
linien_2 = Line([decke_linie, wand_linie])
# https://app.speckle.systems/projects/eba1405a21/models/84e2ea49f8
panel_33 = Panel("https://app.speckle.systems/projects/82c5e61288/models/264d6289f1")
panel_34 = Panel(punkte_2)
data = Data([linien_2, punkte_2])
panel_35 = Panel(data)
# Export in Excel mit Excel+
panel_36 = Panel("A1")
data_2 = Data(panel_2)
dateiname = Panel("DiTWP_2UE_Daten.xlsx")
pfad = Panel("C:\ARI\41_FH_Wien\DiTWP\_W24\1_UE\")
send = Send(
    Stream=panel_33,
    Message="linien und punkte Vorabzug",
    Data=data,
    AutoSend=False,
    BaseId="a699ab627c35497be3aa7bb023f9c212",
    CurrentComponentState="expired",
    KitName="Objects",
    OutputWrappers="https://app.speckle.systems\t82c5e61288\te905dd246d",
    UseDefaultCache=True,
    selectedKitName="Objects")
populate_range = PopulateRange(OriginCell=panel_36, Values=data_2, ByColumn=True)
concatenate = Concatenate(FragmentA=pfad, FragmentB=dateiname)
panel_37 = Panel(send)
construct_worksheet = ConstructWorksheet(Worksheet=populate_range)
name_worksheet = Panel("Test")
data_3 = Data(panel_2)
panel_38 = Panel(concatenate)
name_excel_file = Panel("Punkte_1")
write_to_excel_classic = WriteToExcelClassic(
    WorkbookFilepath=concatenate,
    WorksheetName="Querschnitt",
    Data=data_3,
    LocationAddress="A1",
    Clear=Toggle(False),
    Stream=Toggle(False))
worksheet_properties = WorksheetProperties(Worksheet=construct_worksheet, Name=name_worksheet)  # -> Worksheet, Name, Active
save_workbook = SaveWorkbook(Workbook=worksheet_properties.Worksheet, FileName=name_excel_file, Extensions=0, Activate=Toggle(True))  # -> Workbook, FilePath
