# Grasshopper definition DiTWP_511_Pruefung_Ex_01.gh (Grasshopper 1.0.8)

punkt_koordinaten = Panel("""0,0,0
10,0,0
10,6,0
0,6,0""")
shift_list = ShiftList(List=punkt_koordinaten, Shift=1, Wrap=True)
point = Point(shift_list)

# ----
# Numerierung der Knoten
list_length = ListLength(List=point)
series = Series(Start="1", Step="1", Count=list_length)
text_tag_3d = TextTag3D(Location=point, Text=series, Size=1, Colour=ColourSwatch(SwatchColor=RGB(89, 249, 255)), Justification=7)

square_root = SquareRoot(Value="2")
multiplication = Multiplication(A="1", B=square_root)
# Erstellung Linien Platte
shift_list_2 = ShiftList(List=point, Shift="1", Wrap=True)
panel = Panel("1")
line = Line(StartPoint=point, EndPoint=shift_list_2)
plattendicke = Panel("-0.3")
unit_z = UnitZ(Factor=plattendicke)
# Erstellung Fläche
boundary_surfaces = BoundarySurfaces(Edges=line)
# Fläche und Schwerpunkt ermitteln
area = Area(Geometry=boundary_surfaces)  # -> Area, Centroid
# Erstellung der Stützen
vector_2pt = Vector2Pt(PointA=point, PointB=area.Centroid, Unitize=False)  # -> Vector, Length
panel_2 = Panel(vector_2pt.Vector)
unit_vector = UnitVector(Vector=vector_2pt.Vector)
multiplication_2 = Multiplication(A=unit_vector, B="0.5")
panel_3 = Panel(unit_vector)
move = Move(Geometry=point, Motion=multiplication_2)  # -> Geometry, Transform
multiplication_3 = Multiplication(A=unit_vector, B=multiplication)
move_2 = Move(Geometry=move.Geometry, Motion=multiplication_3)  # -> Geometry, Transform
# Extrusion der Fläche
extrude = Extrude(Base=boundary_surfaces, Direction=unit_z)
rectangle_2pt = Rectangle2Pt(Plane=PlaneXY(0, 0, 0), PointA=move.Geometry, PointB=move_2.Geometry, Radius=0)  # -> Rectangle, Length
boundary_surfaces_2 = BoundarySurfaces(Edges=rectangle_2pt.Rectangle)
unit_z_2 = UnitZ(Factor="4")
area_2 = Area(Geometry=boundary_surfaces_2)  # -> Area, Centroid
unit_z_3 = UnitZ(Factor="4")
extrude_2 = Extrude(Base=rectangle_2pt.Rectangle, Direction=unit_z_2)
panel_4 = Panel(area_2.Area)
extrude_3 = Extrude(Base=boundary_surfaces_2, Direction=unit_z_3)
# Addieren
panel_5 = Panel("2")
# Substrahieren
panel_6 = Panel("2")
# Multiplizieren
panel_7 = Panel("2")
# Dividieren
panel_8 = Panel("2")
# Flächenermittlung
area_3 = Area(Geometry=extrude_2)  # -> Area, Centroid
# Flächenermittlung
area_4 = Area(Geometry=extrude_3)  # -> Area, Centroid
subtraction = Subtraction(A=panel_6, B="2")
addition = Addition(A=panel_5, B="2")
multiplication_4 = Multiplication(A=panel_7, B="2")
division = Division(A=panel_8, B="2")
multiplication_5 = Multiplication(A=panel_4, B="2")
panel_9 = Panel(addition)
panel_10 = Panel(subtraction)
panel_11 = Panel(area_3.Area)
panel_12 = Panel(multiplication_4)
panel_13 = Panel(division)
panel_14 = Panel(area_4.Area)
brep = Brep(simplify([extrude, extrude_3]))
brep_2 = Brep(simplify(graft([extrude, extrude_3])))
subtraction_2 = Subtraction(A=panel_14, B=multiplication_5)
panel_15 = Panel(brep)
panel_16 = Panel(brep_2)
panel_17 = Panel(subtraction_2)
panel_18 = Panel("""4
8
12""")
unit_z_4 = UnitZ(Factor=panel_18)
unit_z_5 = UnitZ(Factor="16.3")
move_3 = Move(Geometry=brep_2, Motion=unit_z_4)  # -> Geometry, Transform
move_4 = Move(Geometry=extrude, Motion=unit_z_5)  # -> Geometry, Transform
brep_3 = Brep([extrude, move_3.Geometry, move_4.Geometry, extrude_3])

# ----
# Volumen ermitteln
brep_4 = Brep(move_3.Geometry)
volume = Volume(Geometry=brep_4)  # -> flatten(Volume), Centroid
panel_19 = Panel(volume.Volume)
mass_addition = MassAddition(Input=volume.Volume)  # -> Result, PartialResults
panel_20 = Panel(mass_addition.Result)

# ----
# Drehung
# Punktliste (leer)
# Auslesen des Wertes von der Punktliste mit dem Index
# XY Ebene, Ursprung in dem Definierten Punkt
# Drehung
# Modell bzw. BREP die gedreht werden sollen
# Sammlung der BREPs die gedreht wurden
brep_5 = Brep(brep_3)
point_2 = Point("0,0,0")
index = Panel("0")
list_item = ListItem(List=point_2, Index=index, Wrap=True)
xy_plane = XYPlane(Origin=list_item)
winkel_in = Panel("45")
rotate = Rotate(Geometry=brep_5, Angle=winkel_in, Plane=xy_plane)  # -> Geometry, Transform
brep_6 = Brep(rotate.Geometry)

# ----
# Modell bzw. BREP die gedreht werden sollen
brep_7 = Brep(brep_6)

# ----
# Verschiebung
# Vektor in X
# Vektor
# Vektor in Y
# Sammlung der BREPs die verschoben wurden
panel_21 = Panel("10")
unit_y = UnitY(Factor="0")
unit_x = UnitX(Factor=panel_21)
vector_xyz = VectorXYZ(XComponent=unit_x, YComponent=unit_y, ZComponent=0)  # -> Vector, Length
move_5 = Move(Geometry=brep_7, Motion=vector_xyz.Vector)  # -> Geometry, Transform

brep_8 = Brep(move_5.Geometry)
