# Grasshopper definition DiTWP_511_Pruefung_Ex_01_unbearbeitet.gh (Grasshopper 1.0.8)

punkt_koordinaten = Panel("""0,0,0
10,0,0
10,6,0
0,6,0""")
shift_list = ShiftList(List=punkt_koordinaten, Shift=1, Wrap=True)
point = Point(shift_list)

# ----
# Numerierung der Knoten
list_length = ListLength(List=point)
series = Series(Start="1", Step="1", Count=list_length)
text_tag_3d = TextTag3D(Location=point, Text=series, Size=1, Colour=ColourSwatch(SwatchColor=RGB(89, 249, 255)), Justification=7)

square_root = SquareRoot(Value="2")
multiplication = Multiplication(A="1", B=square_root)
# Erstellung Linien Platte
shift_list_2 = ShiftList(List=point, Shift="1", Wrap=True)
panel = Panel("1")
line = Line(StartPoint=point, EndPoint=shift_list_2)
plattendicke = Panel("-0.3")
unit_z = UnitZ(Factor=plattendicke)
# Erstellung Fläche
boundary_surfaces = BoundarySurfaces(Edges=line)
# Fläche und Schwerpunkt ermitteln
area = Area(Geometry=boundary_surfaces)  # -> Area, Centroid
# Erstellung der Stützen
vector_2pt = Vector2Pt(PointA=point, PointB=area.Centroid, Unitize=False)  # -> Vector, Length
panel_2 = Panel(vector_2pt.Vector)
unit_vector = UnitVector(Vector=vector_2pt.Vector)
multiplication_2 = Multiplication(A=unit_vector, B="0.5")
panel_3 = Panel(unit_vector)
move = Move(Geometry=point, Motion=multiplication_2)  # -> Geometry, Transform
multiplication_3 = Multiplication(A=unit_vector, B=multiplication)
move_2 = Move(Geometry=move.Geometry, Motion=multiplication_3)  # -> Geometry, Transform
# Extrusion der Fläche
extrude = Extrude(Base=boundary_surfaces, Direction=unit_z)
# Rechteck der Stützen
rectangle_2pt = Rectangle2Pt(Plane=PlaneXY(0, 0, 0), PointA=move.Geometry, PointB=move_2.Geometry, Radius=0)  # -> Rectangle, Length
# Fläche aus Rechteck
boundary_surfaces_2 = BoundarySurfaces(Edges=rectangle_2pt.Rectangle)
unit_z_2 = UnitZ(Factor="4")
# Extrusion Fläche
extrude_2 = Extrude(Base=boundary_surfaces_2, Direction=unit_z_2)
# Extrusion Schaft / Umfang
extrude_3 = Extrude(Base=rectangle_2pt.Rectangle, Direction=unit_z_2)
# Addieren
panel_4 = Panel("2")
# Substrahieren
panel_5 = Panel("2")
# Multiplizieren
panel_6 = Panel("2")
# Dividieren
panel_7 = Panel("2")
subtraction = Subtraction(A=panel_5, B="2")
addition = Addition(A=panel_4, B="2")
multiplication_4 = Multiplication(A=panel_6, B="2")
division = Division(A=panel_7, B="2")
panel_8 = Panel(addition)
panel_9 = Panel(subtraction)
panel_10 = Panel(multiplication_4)
panel_11 = Panel(division)
brep = Brep(simplify([extrude, extrude_2]))
brep_2 = Brep(simplify(graft([extrude, extrude_2])))
panel_12 = Panel(brep)
panel_13 = Panel(brep_2)

# ----
# Volumen ermitteln
brep_3 = Brep()
volume = Volume(Geometry=brep_3)  # -> flatten(Volume), Centroid
panel_14 = Panel(volume.Volume)
mass_addition = MassAddition(Input=volume.Volume)  # -> Result, PartialResults
panel_15 = Panel(mass_addition.Result)

# ----
# Flächenermittlung
area_2 = Area()  # -> Area, Centroid
panel_16 = Panel(area_2.Area)

# ----
# Letzte Decke
panel_17 = Panel("16.3")
# Geschosse kopieren
panel_18 = Panel("""4
8
12""")
unit_z_3 = UnitZ(Factor=panel_18)
unit_z_4 = UnitZ(Factor=panel_17)
move_3 = Move(Motion=unit_z_3)  # -> Geometry, Transform
move_4 = Move(Motion=unit_z_4)  # -> Geometry, Transform

# ----
# Drehung
# Punktliste (leer)
# Auslesen des Wertes von der Punktliste mit dem Index
# XY Ebene, Ursprung in dem Definierten Punkt
# Drehung
# Modell bzw. BREP die gedreht werden sollen
# Sammlung der BREPs die gedreht wurden
brep_4 = Brep()
point_2 = Point()
index = Panel("0")
list_item = ListItem(List=point_2, Index=index, Wrap=True)
xy_plane = XYPlane(Origin=list_item)
winkel_in = Panel("45")
rotate = Rotate(Geometry=brep_4, Angle=winkel_in, Plane=xy_plane)  # -> Geometry, Transform
brep_5 = Brep(rotate.Geometry)

# ----
# Verschiebung
# Vektor in X
# Vektor
# Vektor in Y
# Sammlung der BREPs die verschoben wurden
# Modell bzw. BREP die gedreht werden sollen
panel_19 = Panel("10")
brep_6 = Brep()
unit_y = UnitY(Factor="0")
unit_x = UnitX(Factor=panel_19)
vector_xyz = VectorXYZ(XComponent=unit_x, YComponent=unit_y, ZComponent=0)  # -> Vector, Length
move_5 = Move(Geometry=brep_6, Motion=vector_xyz.Vector)  # -> Geometry, Transform
brep_7 = Brep(move_5.Geometry)
